# Grasshopper definition 记忆曲线.gh (Grasshopper 1.0.8)

curve = Curve(<curve referenced from the Rhino model>)
number_slider = Slider(0.01, range=0..0.01)
construct_point = ConstructPoint(XCoordinate=0, YCoordinate=0, ZCoordinate=0)
f = Slider(6.376, range=-100..100)
length = Length(Curve=curve)
multiplication = Multiplication(A=Slider(20, range=0..100), B=Slider(7, range=0..10))
division = Division(A=length, B=multiplication)

# ---- group: x
series = Series(Start=Slider(0, range=0..100), Step=division, Count=multiplication)

# ----
unit_x = UnitX(Factor=series)

# ---- group: t
number = Number(simplify(graft(series)))

# ----
curve_2 = Curve(<curve referenced from the Rhino model>)
move = Move(Geometry=construct_point, Motion=unit_x)  # -> graft(Geometry), Transform
move_2 = Move(Geometry=curve_2, Motion=unit_x)  # -> Geometry, Transform

# ---- group: taget
curve_3 = Curve(<curve referenced from the Rhino model>)

# ----
curve_curve = CurveCurve(CurveA=move_2.Geometry, CurveB=curve_3)  # -> simplify(Points), ParamsA, ParamsB
galapagos = Galapagos(fitness=division_2, gene=[b, a, c, d, f])
panel = Panel(number)
deconstruct = Deconstruct(Point=curve_curve.Points)  # -> XComponent, YComponent, ZComponent
colour_cmyk = ColourCMYK(Cyan=0, Magenta=0, Yellow=0, Key=0)

a = Slider(79.323, range=-200..200)
b = Slider(-0.409, range=-1..1)

multiplication_2 = Multiplication(A=number_slider, B=b)

multiplication_3 = Multiplication(A=number, B=multiplication_2)
power_of_e = PowerOfE(Value=multiplication_3)
multiplication_4 = Multiplication(A=a, B=power_of_e)

panel_2 = Panel(power_of_e)

c = Slider(15.098, range=-1000..1000)
d = Slider(-0.52, range=-1..1)

multiplication_5 = Multiplication(A=number_slider, B=d)

multiplication_6 = Multiplication(A=number, B=multiplication_5)
power_of_e_2 = PowerOfE(Value=multiplication_6)
multiplication_7 = Multiplication(A=c, B=power_of_e_2)

addition = Addition(A=multiplication_4, B=multiplication_7)
addition_2 = Addition(A=addition, B=f)
unit_y = UnitY(Factor=addition_2)
move_3 = Move(Geometry=move.Geometry, Motion=unit_y)  # -> simplify(Geometry), Transform
deconstruct_2 = Deconstruct(Point=move_3.Geometry)  # -> XComponent, YComponent, ZComponent
subtraction = Subtraction(A=deconstruct.YComponent, B=deconstruct_2.YComponent)
square = Square(Value=subtraction)
mass_addition = MassAddition(Input=flatten(square))  # -> Result, PartialResults
division_2 = Division(A=mass_addition.Result, B=multiplication)
panel_3 = Panel(division_2)
line = Line(StartPoint=curve_curve.Points, EndPoint=move_3.Geometry)
custom_preview = CustomPreview(Geometry=line, Material=colour_cmyk)
